# Grasshopper definition assign1_takeaki_circle container.gh (Grasshopper 1.0.7)
# plug-ins: Kangaroo2 Components

radius_of_outer_curve_in_x = Slider(57, range=0..100)
radius_of_outer_curve_in_y = Slider(34, range=0..100)
radius_of_inner_curve = Slider(8, range=0..10)
number_of_inner_circle = Slider(50, range=10..50)
reset = Button()
radius_of_outer_curve_in_x_2 = GetNumber(radius_of_outer_curve_in_x, AtLeast=1, AtMost=1, Maximum=1.797693135e+308, Minimum=-1.797693135e+308)
radius_of_outer_curve_in_y_2 = GetNumber(radius_of_outer_curve_in_y, AtLeast=1, AtMost=1, Maximum=1.797693135e+308, Minimum=-1.797693135e+308)
radius_of_inner_curve_2 = GetNumber(radius_of_inner_curve, AtLeast=1, AtMost=1, Maximum=1.797693135e+308, Minimum=-1.797693135e+308)
number_of_inner_circle_2 = GetNumber(number_of_inner_circle, AtLeast=1, AtMost=1, Maximum=1.797693135e+308, Minimum=-1.797693135e+308)
reset_2 = GetBoolean(reset, AtLeast=1, AtMost=1, FalseValue="False", TrueValue="True")
make_it_true = GetBoolean(Toggle(False), AtLeast=1, AtMost=1, FalseValue="False", TrueValue="True")
random_seed = Slider(48, range=0..100)
ellipse = Ellipse(Plane=PlaneXY(0, 0, 0), Radius1=radius_of_outer_curve_in_x_2, Radius2=radius_of_outer_curve_in_y_2)  # -> Ellipse, Focus1, Focus2
srf = Surface(ellipse.Ellipse)
popgeo = PopulateGeometry(Geometry=srf, Count=number_of_inner_circle_2, Seed=random_seed)
min = Minimum(A=radius_of_outer_curve_in_x_2, B=radius_of_outer_curve_in_y_2)
crv = Curve(ellipse.Ellipse)
sc = SphereCollide(Points=popgeo, Radius=radius_of_inner_curve_2, Strength=1)
cpc = CurvePointCollide(Points=popgeo, Curve=crv, Plane=PlaneXY(0, 0, 0), Interior=True, Strength=Slider(20, range=0..100))
addition = Addition(A=min, B=radius_of_inner_curve_2)
merge = Merge(Data1=sc, Data2=cpc)
division = Division(A=addition, B=min)
entwine = Entwine(Branch01=merge, FlattenInputs=True)
bouncysolver = BouncySolver(GoalObjects=entwine, Reset=reset_2, Threshold=1e-15, Tolerance=0.0001, Damping=0.99, Iterations=10, On=make_it_true)  # -> I, V, O
scale = Scale(Geometry=crv, Center=Point(0, 0, 0), Factor=division)  # -> Geometry, Transform
cir = Circle(Plane=bouncysolver.V, Radius=radius_of_inner_curve_2)
merge_2 = Merge(Data1=cir, Data2=scale.Geometry)
context_bake = ContextBake(CircleContainer=merge_2)
